vi "Error Handler.gvi"   [LabVIEW NXG 3.1.0]
# If there is an Error, display the details in a popup dialog
inputs:
  "error in": error
outputs:
  "error out": error
uses:
  Error Handling::Get Error Details.gvi
diagram:
  call "Get Error Details.gvi"(error in=$"error in") -> (status=w1, description=w2, error out=w3)
  # If there is an Error, display the details in a popup dialog
  case (w1) {
    frame False, Default { }
    frame True {
      One Button Dialog(message=w2)
    }
  }
  $"error out" <- w3
