vi "Get Error Details.gvi"   [LabVIEW NXG 3.1.0]
# This VI gets the error description from the error cluster
inputs:
  "error in": error
outputs:
  "error out": error
  "status": bool
  "code": i32
  "description": string
uses:
  NI::G Core::Error::Clear Error Cluster.gvi
diagram:
  # The Source of the Error contains a JSON object with the Error description
  Property Node(instance in=$"error in") -> ("status"=w1, "code"=w2, "source"=w3, instance out=w4)
  # This VI gets the error description from the error cluster
  $"error out" <- w4
  $status <- w1
  # Search for the beginning of the JSON string
  Match Pattern(regular expression="{", string=w3) -> (after substring=w5, match substring=w6)
  Concatenate Strings(w6, w5) -> w7
  Unflatten From JSON(JSON string=w7, type and defaults=cluster{"desc": string} {all zero or empty}) -> (error out=w8, value=w9)
  Property Node(instance in=w9) -> ("desc"=w10)
  Is Empty String Or Path(string/path=w10) -> w11
  # If the JSON object was not found, output the error source as the description
  Select(s=w11, t=w3, f=w10) -> w12
  $description <- w12
  $code <- w2
  call "Clear Error Cluster.gvi"(error in=w8)
