vi "Close Connection.gvi"   [LabVIEW NXG 3.1.0]
# Destroy the HTTP Connection handle
inputs:
  "Connection in": "Connection--cluster.gtype"
  "error in": error
outputs:
  "error out": error
types:
  "Client Handle.gtype" = u32
  "Connection--cluster.gtype" = cluster{"client handle": "Client Handle.gtype", "Root URL": string}
uses:
  NI::HTTP::Close HTTP Handle.gvi
diagram:
  # Destroy the HTTP Connection handle
  Property Node(instance in=$"Connection in") -> ("client handle"=w1)
  call "Close HTTP Handle.gvi"(client handle=w1) -> (error out=w2)
  Merge Errors($"error in", w2) -> (error out=w3)
  $"error out" <- w3
