vi "DELETE.gvi"   [LabVIEW NXG 3.1.0]
# Perform a DELETE web request to the Web Service
inputs:
  "Connection in": "Connection--cluster.gtype", required
  "Method name": string, required
  "error in": error
outputs:
  "Connection out": "Connection--cluster.gtype"
  "status code": u32
  "body": string
  "Timed out?": bool
  "error out": error
types:
  "Client Handle.gtype" = u32
  "Connection--cluster.gtype" = cluster{"client handle": "Client Handle.gtype", "Root URL": string}
uses:
  NI::HTTP::DELETE.gvi
  HTTP Client API::Error Handling::Handle HTTP Request Error.gvi
diagram:
  # Perform a DELETE web request to the Web Service
  Property Node(instance in=$"Connection in") -> ("client handle"=w1, "Root URL"=w2, instance out=w3)
  Concatenate Strings(w2, $"Method name") -> w4
  call "DELETE.gvi"(client handle=w1, url=w4, error in=$"error in") -> (status code=w5, client handle out=w6, body=w7, error out=w8)
  Property Node(instance in=w3, "client handle"=w6) -> (instance out=w9)
  $"Connection out" <- w9
  call "Handle HTTP Request Error.gvi"(status code=w5, body=w7, error in (no error)=w8) -> (Timed out?=w10, error out=w11)
  $"Timed out?" <- w10
  $"error out" <- w11
  $body <- w7
  $"status code" <- w5
