vi "Open Connection.gvi"   [LabVIEW NXG 3.1.0]
# Open an HTTP Connection handle and configure CORS to allow including credentials
inputs:
  "error in": error
  "Root URL": string
outputs:
  "Connection": "Connection--cluster.gtype"
  "error out": error
types:
  "Client Handle.gtype" = u32
  "Connection--cluster.gtype" = cluster{"client handle": "Client Handle.gtype", "Root URL": string}
uses:
  NI::HTTP::Open HTTP Handle.gvi
  NI::HTTP::Configure CORS.gvi
diagram:
  call "Open HTTP Handle.gvi"(error in=$"error in") -> (client handle out=w1, error out=w2)
  call "Configure CORS.gvi"(client handle=w1, include credentials during CORS=TRUE, error in=w2) -> (client handle out=w3, error out=w4)
  Reverse String(string=$"Root URL") -> (reversed=w5)
  String Subset(length (rest)=1, string=w5) -> w6
  # Open an HTTP Connection handle and configure CORS to allow including credentials
  # Ensure that the Root URL provided contains a forward slash at the end
  Is Equal(x=w6, y="/") -> w7
  Concatenate Strings($"Root URL", "/") -> w8
  Select(s=w7, t=$"Root URL", f=w8) -> w9
  Property Node(instance in="Connection--cluster.gtype" {all zero or empty}, "Root URL"=w9, "client handle"=w3) -> (instance out=w10)
  $Connection <- w10
  $"error out" <- w4
