vi "Generic HTTP Error--error.gvi"   [LabVIEW NXG 3.1.0]
# Converts HTTP Status code into a LabVIEW Error with details
inputs:
  "HTTP Code": u32, required
  "Details": string, required
outputs:
  "error out": error
uses:
  NI::G Core::Error::Build Error Cluster.gvi
diagram:
  Add($"HTTP Code", 501000) -> w1
  # Converts HTTP Status code into a LabVIEW Error with details
  call "Build Error Cluster.gvi"(code=w1, description=$Details, include call chain=TRUE) -> (error out=w2)
  $"error out" <- w2
