vi "Handle HTTP Request Error.gvi"   [LabVIEW NXG 3.1.0]
# This VI handles errors from HTTP requests
inputs:
  "status code": u32, required
  "body": string, required
  "error in (no error)": error
outputs:
  "Timed out?": bool
  "error out": error
uses:
  NI::G Core::Error::Legacy::Clear Errors.gvi
  HTTP Client API::Error Constants::Timeout Error--error.gvi
  HTTP Client API::Error Constants::Server Unreachable Error--error.gvi
  HTTP Client API::Error Constants::Generic HTTP Error--error.gvi
diagram:
  # Converts error 56 into a Timeout error
  call "Clear Errors.gvi"(specific error code to clear=56, error in=$"error in (no error)") -> (specific error cleared?=w1, error out=w2)
  $"Timed out?" <- w1
  # This VI handles errors from HTTP requests
  case (w1) {
    frame False, Default {
      w3 = default
    }
    frame True {
      call "Timeout Error--error.gvi"() -> (error out=w3)
    }
  }
  call "Clear Errors.gvi"(specific error code to clear=59, error in=w2) -> (specific error cleared?=w4, error out=w5)
  call "Clear Errors.gvi"(specific error code to clear=363500, error in=w5) -> (specific error cleared?=w6, error out=w7)
  # Converts errors 59 or 363500 into a Server Unreachable error
  Logical Or(w4, w6) -> w8
  case (w8) {
    frame False, Default {
      w9 = default
    }
    frame True {
      call "Server Unreachable Error--error.gvi"() -> (error out=w9)
    }
  }
  w10 = cluster{"error": string, "reason": string} {all zero or empty}
  # Retrieve error details from HTTP response body
  Unflatten From JSON(JSON string=$body, default null elements=TRUE, type and defaults=w10) -> (error out=w11, value=w12)
  Property Node(instance in=w12) -> ("reason"=w13)
  # If HTTP Status code is greater or equal to 400, generate a Generic HTTP Error with details
  call "Generic HTTP Error--error.gvi"(HTTP Code=$"status code", Details=w13) -> (error out=w14)
  Is Greater Or Equal(x=$"status code", y=400) -> w15
  Select(s=w15, t=w14, f=no error) -> w16
  Merge Errors(w7, w3, w9, w16) -> (error out=w17)
  $"error out" <- w17
  call "Clear Errors.gvi"(error in=w11)
