vi "Get All Package Versions.gvi"   [LabVIEW NXG 4.0.0]
# Perform a Get TestResults request on the Web Service
inputs:
  "Connection in": "Connection--cluster.gtype", required
  "error in": error
outputs:
  "Connection out": "Connection--cluster.gtype"
  "error out": error
  "Package Versions": "Package Version--cluster.gtype"[]
  "All Versions text": string[]
types:
  "Client Handle.gtype" = u32
  "Connection--cluster.gtype" = cluster{"client handle": "Client Handle.gtype", "Root URL": string}
  "Package Version--cluster.gtype" = cluster{"ReleaseDate": string, "Version": string, "Name": string, "DisplayName": string, "Description": string, "Vendor": string, "Author": string, "Release Notes": string, "Dependencies": string[], "IconURL": string, "PackageURL": string, "RepoType": string, "RepoName": string}
uses:
  HTTP Client API::Connection::GET.gvi
diagram:
  call "GET.gvi"(Connection in=$"Connection in", Method name="Packages/Versions", error in=$"error in") -> (Connection out=w1, body=w2, error out=w3)
  $"Connection out" <- w1
  Unflatten From JSON(JSON string=w2, error in (no error)=w3, type and defaults="Package Version--cluster.gtype"[] []) -> (error out=w4, value=w5)
  $"Package Versions" <- w5
  $"error out" <- w4
  for {
    w6 = each element of w5
    Property Node(instance in=w6) -> ("Version"=w8)
    append w8 to w7
  }
  $"All Versions text" <- w7
