vi "Get Package Details.gvi"   [LabVIEW NXG Preview 4.0.0]
# Perform a Get TestResults request on the Web Service
inputs:
  "Connection in": "Connection--cluster.gtype", required
  "error in": error
outputs:
  "Connection out": "Connection--cluster.gtype"
  "error out": error
  "Package Details": "Package Version.gtype"
types:
  "Client Handle.gtype" = u32
  "Connection--cluster.gtype" = cluster{"client handle": "Client Handle.gtype", "Root URL": string}
  "Version Number--cluster.gtype" = cluster{"Major": i32, "Minor": i32, "Fix": i32, "Build": i32}
  "Package Version.gtype" = cluster{"Version Number": "Version Number--cluster.gtype", "Version Text": string, "ReleaseDate": string, "DisplayName": string, "Description": string, "Summary": string, "Copyright": string, "Vendor": string, "Author": string, "Release Notes": string, "Dependencies": string[], "IconURL": string, "PackageURL": string}
uses:
  HTTP Client API::Connection::GET.gvi
diagram:
  call "GET.gvi"(Connection in=$"Connection in", Method name="Packages/Details", error in=$"error in") -> (Connection out=w1, body=w2, error out=w3)
  $"Connection out" <- w1
  Unflatten From JSON(JSON string=w2, error in (no error)=w3, type and defaults="Package Version.gtype" {all zero or empty}) -> (error out=w4, value=w5)
  $"Package Details" <- w5
  $"error out" <- w4
