vi "Get Package Filters.gvi"   [LabVIEW NXG Preview 4.0.0]
# Perform a Get TestResults request on the Web Service
inputs:
  "Connection in": "Connection--cluster.gtype", required
  "error in": error
outputs:
  "Connection out": "Connection--cluster.gtype"
  "error out": error
  "Filters": "Package Filters.gtype"
types:
  "Client Handle.gtype" = u32
  "Connection--cluster.gtype" = cluster{"client handle": "Client Handle.gtype", "Root URL": string}
  "Package Filters.gtype" = cluster{"Repo Types": string[], "Repo Names": string[]}
uses:
  HTTP Client API::Connection::GET.gvi
diagram:
  call "GET.gvi"(Connection in=$"Connection in", Method name="Packages/Filters", error in=$"error in") -> (Connection out=w1, body=w2, error out=w3)
  $"Connection out" <- w1
  Unflatten From JSON(JSON string=w2, error in (no error)=w3, type and defaults="Package Filters.gtype" {all zero or empty}) -> (error out=w4, value=w5)
  $Filters <- w5
  $"error out" <- w4
