vi "List Packages.gvi"   [LabVIEW NXG 4.0.0]
# Perform a Get TestResults request on the Web Service
inputs:
  "Connection in": "Connection--cluster.gtype", required
  "error in": error
  "List Packages Settings": "List Packages Settings--cluster.gtype" = {"PageNumber"=1, "SearchCriteria"="", "Filters"={"RepoTypes"=[], "RepoNames"=[]}}, required
outputs:
  "Connection out": "Connection--cluster.gtype"
  "error out": error
  "Packages": "Package--cluster.gtype"[]
  "List Details": "List Details--cluster.gtype"
types:
  "Client Handle.gtype" = u32
  "Connection--cluster.gtype" = cluster{"client handle": "Client Handle.gtype", "Root URL": string}
  "Package Version--cluster.gtype" = cluster{"ReleaseDate": string, "Version": string, "Name": string, "DisplayName": string, "Description": string, "Vendor": string, "Author": string, "Release Notes": string, "Dependencies": string[], "IconURL": string, "PackageURL": string, "RepoType": string, "RepoName": string}
  "Package--cluster.gtype" = cluster{"Name": string, "DisplayName": string, "RepoType": string, "RepoName": string, "Versions": "Package Version--cluster.gtype"[]}
  "List Details--cluster.gtype" = cluster{"TotalPackages": i32, "TotalPages": i32, "PagesBefore": i32, "PagesAfter": i32, "ItemsPerPage": i32}
  "Package Filters.gtype" = cluster{"RepoTypes": string[], "RepoNames": string[]}
  "List Packages Settings--cluster.gtype" = cluster{"PageNumber": i32, "SearchCriteria": string, "Filters": "Package Filters.gtype"}
  T1 = cluster{"TotalPackages": i32, "TotalPages": i32, "PagesBefore": i32, "PagesAfter": i32, "ItemsPerPage": i32, "Packages": "Package--cluster.gtype"[]}
uses:
  HTTP Client API::Connection::POST.gvi
diagram:
  Flatten To JSON(anything=$"List Packages Settings") -> (JSON string=w1)
  call "POST.gvi"(Connection in=$"Connection in", Method name="Packages/List", buffer=w1, error in=$"error in") -> (Connection out=w2, body=w3, error out=w4)
  $"Connection out" <- w2
  Unflatten From JSON(JSON string=w3, error in (no error)=w4, type and defaults=T1 {all zero or empty}) -> (error out=w5, value=w6)
  $"error out" <- w5
  Property Node(instance in=w6) -> ("Packages"=w7, "TotalPackages"=w8, "TotalPages"=w9, "PagesBefore"=w10, "PagesAfter"=w11, "ItemsPerPage"=w12)
  $Packages <- w7
  Property Node(instance in="List Details--cluster.gtype" {all zero or empty}, "TotalPackages"=w8, "TotalPages"=w9, "PagesBefore"=w10, "PagesAfter"=w11, "ItemsPerPage"=w12) -> (instance out=w13)
  $"List Details" <- w13
