vi "Set Package.gvi"   [LabVIEW NXG Preview 4.0.0]
# Perform a Get TestResults request on the Web Service
inputs:
  "Connection in": "Connection--cluster.gtype", required
  "error in": error
  "Name": string, required
  "Version": string, required
outputs:
  "Connection out": "Connection--cluster.gtype"
  "error out": error
types:
  "Client Handle.gtype" = u32
  "Connection--cluster.gtype" = cluster{"client handle": "Client Handle.gtype", "Root URL": string}
uses:
  HTTP Client API::Connection::POST.gvi
diagram:
  w1 = cluster{"Name": string, "Version": string} {all zero or empty}
  Property Node(instance in=w1, "Name"=$Name, "Version"=$Version) -> (instance out=w2)
  Flatten To JSON(anything=w2) -> (JSON string=w3)
  call "POST.gvi"(Connection in=$"Connection in", Method name="Packages/Set", buffer=w3, error in=$"error in") -> (Connection out=w4, error out=w5)
  $"Connection out" <- w4
  $"error out" <- w5
