vi "WebServices Version.gvi"   [LabVIEW NXG 3.1.0]
# Query the Web Services for its Version
inputs:
  "Connection in": "Connection--cluster.gtype", required
  "error in": error
outputs:
  "Connection out": "Connection--cluster.gtype"
  "error out": error
  "version": string
types:
  "Client Handle.gtype" = u32
  "Connection--cluster.gtype" = cluster{"client handle": "Client Handle.gtype", "Root URL": string}
uses:
  HTTP Client API::Connection::GET.gvi
diagram:
  call "GET.gvi"(Connection in=$"Connection in", Method name="Version", error in=$"error in") -> (Connection out=w1, body=w2, error out=w3)
  Unflatten From JSON(JSON string=w2, error in (no error)=w3, type and defaults=cluster{"version": string} {all zero or empty}) -> (error out=w4, value=w5)
  # Query the Web Services for its Version
  Property Node(instance in=w5) -> ("version"=w6)
  $version <- w6
  $"Connection out" <- w1
  $"error out" <- w4
