vi "Enqueue Message (Array).gviweb"   [LabVIEW NXG 3.1.0]
# For a regular message, enqueue the message. For a priority message, enqueue it at the front of the queue.
inputs:
  "message queue in": Queue<T1>, required
  "error in": error
  "message array": string[], required
  "message data array": string[]
  "priority message array": bool[]
outputs:
  "message queue out": Queue<T1>
  "error out": error
types:
  T1 = cluster{"Message": string, "Message Data": string}
diagram:
  $"message queue out" <- $"message queue in"
  # This VI takes an array of messages, message data, and priority message settings, and enqueues those messages. The For Loop auto-indexes on the Message Array only. This allows a user to optionally wire the Message Data Array and Priority Message? Array values.
  case ($"error in") {
    frame Error, Default {
      w1 = $"error in"
    }
    frame No Error {
      s1 = $"error in"  # shift register
      for (iteration -> i1) {
        w2 = each element of $"message array"
        Array Index(array=$"priority message array") -> (out0[i1]=w3)
        Array Index(array=$"message data array") -> (out0[i1]=w4)
        Property Node(instance in=T1 {all zero or empty}, "Message"=w2, "Message Data"=w4) -> (instance out=w5)
        # For a regular message, enqueue the message.  For a priority message, enqueue it at the front of the queue.
        case (w3) {
          frame False, Default {
            Enqueue Element(element=w5, error in=s1, queue=$"message queue in") -> (error out=w6)
          }
          frame True {
            Enqueue Element At Opposite End(element=w5, error in=s1, queue=$"message queue in") -> (error out=w6)
          }
        }
        next s1 = w6
      }
      w1 = s1
    }
  }
  $"error out" <- w1
