vi "Enqueue Message (Single).gviweb"   [LabVIEW NXG 3.1.0]
# For a regular message, enqueue the message. For a priority message, enqueue it at the front of the queue.
inputs:
  "message queue in": Queue<T1>, required
  "message": string, required
  "message data": string
  "error in": error
  "priority message": bool
outputs:
  "message queue out": Queue<T1>
  "error out": error
types:
  T1 = cluster{"Message": string, "Message Data": string}
diagram:
  $"message queue out" <- $"message queue in"
  # For a regular message, enqueue the message.  For a priority message, enqueue it at the front of the queue.
  case ($"error in") {
    frame Error, Default {
      w1 = $"error in"
    }
    frame No Error {
      Property Node(instance in=T1 {all zero or empty}, "Message"=$message, "Message Data"=$"message data") -> (instance out=w2)
      case ($"priority message") {
        frame False, Default {
          Enqueue Element(element=w2, error in=$"error in", queue=$"message queue in") -> (error out=w1)
        }
        frame True {
          Enqueue Element At Opposite End(element=w2, error in=$"error in", queue=$"message queue in") -> (error out=w1)
        }
      }
    }
  }
  $"error out" <- w1
