vi "PackageDetails.gviweb"   [LabVIEW NXG 4.0.0]
panel controls:
  "Download": bool
  "Version": i32
panel indicators:
  "URL Image": string
  "DisplayName": string
  "PkgIcon": string
  "ReleaseDate": string
  "Vendor": string
  "Author": string
  "Description": string
  "Release Notes": string
  "Dependencies": string
  "PrototypedBy": string
  "Name": string
  "GPM Install Command:": string
types:
  "Package Version--cluster.gtype" = cluster{"ReleaseDate": string, "Version": string, "Name": string, "DisplayName": string, "Description": string, "Vendor": string, "Author": string, "Release Notes": string, "Dependencies": string[], "IconURL": string, "PackageURL": string, "RepoType": string, "RepoName": string}
  T1 = cluster{"BaseURL": string, "Package Details": "Package Version--cluster.gtype", "All Versions": string[]}
uses:
  QMH support::Message Queue::Create All Message Queues.gviweb
  HTTP Client API::Base URL--constant.gvi
  QMH support::Message Queue::Dequeue Message.gviweb
  WebApp::Support::Get Package Name and Version from URL.gvi
  HTTP Client API::Connection::Open Connection.gvi
  HTTP Client API::Packages::Set Package.gvi
  HTTP Client API::Connection::Close Connection.gvi
  QMH support::Message Queue::Enqueue Message (Single).gviweb
  BusyStateAPI::Set Busy.gviweb
  HTTP Client API::Packages::Get Package Details.gvi
  HTTP Client API::Packages::Get All Package Versions.gvi
  BusyStateAPI::Unset Busy.gviweb
  WebApp::Support::JSON Timestamp to Display.gvi
  WebApp::Support::Join Strings.gvi
  QMH support::Message Queue::Enqueue Message (Array).gviweb
  WebApp::Support::RepoType string to enum.gvi
  WebApp::Support::Generate GPM Install Command.gvi
  RedirectURL::Redirect.jsli::Redirect
  WebApp::Support::GPM Install Instructions URL--constant.gvi
  NI::G Core::Error::Read Error Code.gvi
  Error Handling::Error Handler.gvi
  NI::G Core::Error::Build Error Cluster.gvi
  QMH support::Error Handler - Message Handling Loop.gviweb
  QMH support::Error Handler - Event Handling Loop.gviweb
diagram:
  w1 = bool TRUE  # Stop Event
  Create User Event[EventName="Stop Event"](user event data type=w1) -> (error out=w2, user event out=w3)
  call "Create All Message Queues.gviweb"(error in=w2) -> (message queues=w4, error out=w5)
  call "Base URL--constant.gvi"() -> (Base URL=w6)
  Property Node(instance in=T1 {all zero or empty}, "BaseURL"=w6) -> (instance out=w7)
  Property Node(instance in=w4) -> ("UI"=w8)
  s1 = w7  # shift register
  while {
    call "Dequeue Message.gviweb"(message queue in=w8, error in=w5) -> (message queue out=w9, message=w10, message data=w11, error out=w12)
    # s1: Data
    # w3: Stop Event
    case (w10) ignore case {  # Message Cases
      frame "Initialize" {
        call "Get Package Name and Version from URL.gvi"(error in=w12) -> (Package Name=w16, Package Version=w17, error out=w18)
        # Get the Package Name and Version to display from the URL Search parameters.
        # Set the Package Name and Version on the Web Server session
        # Go to "Get Package Details" case
        Property Node(instance in=s1) -> ("BaseURL"=w19, instance out=w14)
        call "Open Connection.gvi"(Root URL=w19, error in=w18) -> (Connection=w20, error out=w21)
        call "Set Package.gvi"(Connection in=w20, Name=w16, Version=w17, error in=w21) -> (Connection out=w22, error out=w23)
        call "Close Connection.gvi"(Connection in=w22, error in=w23) -> (error out=w24)
        call "Enqueue Message (Single).gviweb"(message queue in=w9, message="Get Package Details", error in=w24) -> (error out=w13)
        w15 = default
      }
      frame "Get Package Details" {
        Property Node(instance in=s1) -> ("BaseURL"=w25, instance out=w26)
        call "Set Busy.gviweb"(error in=w12) -> (error out=w27)
        call "Open Connection.gvi"(Root URL=w25, error in=w27) -> (Connection=w28, error out=w29)
        call "Get Package Details.gvi"(Connection in=w28, error in=w29) -> (Connection out=w30, Package Details=w31, error out=w32)
        call "Get All Package Versions.gvi"(Connection in=w30, error in=w32) -> (Connection out=w33, All Versions text=w34, error out=w35)
        Property Node(instance in=w26, "Package Details"=w31, "All Versions"=w34) -> (instance out=w14)
        call "Close Connection.gvi"(Connection in=w33, error in=w35) -> (error out=w36)
        call "Unset Busy.gviweb"(error in=w36) -> (error out=w37)
        call "Enqueue Message (Single).gviweb"(message queue in=w9, message="Display Package Details", error in=w37) -> (error out=w13)
        w15 = default
      }
      frame "Display Package Details" {
        Property Node(instance in=s1) -> ("Package Details"=w38, instance out=w14)
        Property Node(instance in=w38) -> ("Name"=w39, "DisplayName"=w40, "IconURL"=w41, "ReleaseDate"=w42, "Vendor"=w43, "Author"=w44, "Description"=w45, "Release Notes"=w46, "Dependencies"=w47)
        $Name <- w39
        $DisplayName <- w40
        $PkgIcon <- w41
        call "JSON Timestamp to Display.gvi"(JSON Timestamp=w42) -> (Display Timestamp=w48)
        $ReleaseDate <- w48
        $Vendor <- w43
        $Author <- w44
        $Description <- w45
        $"Release Notes" <- w46
        call "Join Strings.gvi"(String Array Input=w47, Separator="\r\n") -> (String output=w49)
        $Dependencies <- w49
        call "Enqueue Message (Array).gviweb"(message queue in=w9, message array=["Display Versions", "Display Download Instructions"], error in=w12) -> (error out=w13)
        w15 = default
      }
      frame "Display Versions" {
        Property Node(instance in=s1) -> ("All Versions"=w50, "Package Details:Version"=w51, instance out=w14)
        Search 1D Array(1D array=w50, element=w51) -> (index of element=w52)
        Property Node(instance in=reference to "Version", "Items"=w50, "Value"=w52)
        w13 = w12
        w15 = default
      }
      frame "Display Download Instructions" {
        Property Node(instance in=s1) -> ("Package Details"=w53, instance out=w14)
        Property Node(instance in=w53) -> ("RepoType"=w54)
        call "RepoType string to enum.gvi"(RepoType string=w54) -> (RepoType=w55)
        case (w55) {
          frame "VIPM", Default {
            w56 = "Download Package"
            w57 = default
            w58 = default
          }
          frame "GPM" {
            call "Generate GPM Install Command.gvi"(Package Version=w53) -> (GPM Install Command=w58)
            w56 = "GPM Install Instructions"
            w57 = TRUE
          }
        }
        Build Array(w56, w56) -> w59
        Property Node(instance in=reference to "Download", "Text"=w59)
        Property Node(instance in=reference to "GPM Install Command:", "Visible"=w57, "Value"=w58)
        w13 = w12
        w15 = default
      }
      frame "Version changed" {
        call "Set Busy.gviweb"(error in=w12) -> (error out=w60)
        Property Node(instance in=s1) -> ("Package Details:Name"=w61, "All Versions"=w62, instance out=w14)
        Decimal String To Number(string=w11) -> (number=w63)
        Array Index(array=w62) -> (out0[w63]=w64)
        Format Into String(formatString="PackageDetails.html?Name=%s&Version=%s", w61, w64) -> w65
        call "Redirect"(URL=w65, target="_self", error in=w60) -> (error out=w66)
        call "Unset Busy.gviweb"(error in=w66) -> (error out=w13)
        w15 = default
      }
      frame "Download Package" {
        call "Set Busy.gviweb"(error in=w12) -> (error out=w67)
        Property Node(instance in=s1) -> ("Package Details:PackageURL"=w68, "Package Details:RepoType"=w69, instance out=w14)
        call "RepoType string to enum.gvi"(RepoType string=w69) -> (RepoType=w70)
        case (w70) {
          frame "VIPM", Default {
            w71 = w68
          }
          frame "GPM" {
            call "GPM Install Instructions URL--constant.gvi"() -> (GPM Install Instructions URL=w71)
          }
        }
        call "Redirect"(URL=w71, target="_blank", error in=w67) -> (error out=w72)
        call "Unset Busy.gviweb"(error in=w72) -> (error out=w13)
        w15 = default
      }
      frame "Error" {
        # Process Error
        w73 = no error  # Error
        Unflatten From JSON(JSON string=w11, error in (no error)=w12, type and defaults=w73) -> (error out=w13, value=w74)
        call "Read Error Code.gvi"(error in=w74) -> (code=w75)
        case (w75) {
          frame 501401 {
            # Redirect to Login page
            call "Redirect"(URL="Login.html")
          }
          frame 0, Default {
            # Display Error
            call "Error Handler.gvi"(error in=w74)
          }
        }
        w14 = s1
        w15 = default
      }
      frame "---Copy This Frame---" {
        Merge Errors(w12) -> (error out=w13)
        w14 = s1
        w15 = default
      }
      frame "Exit" {
        # Release the message queue reference
        Release Queue(error in=w12, queue=w9) -> (error out=w76)
        Generate User Event(event data=TRUE, user event=w3) -> (error out=w77)
        Merge Errors(w77, w76) -> (error out=w13)
        # Stop the VI
        w14 = s1
        w15 = TRUE
      }
      frame Default {
        w78 = "The invalid message string \"%s\" was received in the Message Handling Loop."
        Format Into String(formatString=w78, w10) -> w79
        call "Build Error Cluster.gvi"(code=1, description=w79) -> (error out=w13)
        w14 = s1
        w15 = default
      }
    }
    call "Error Handler - Message Handling Loop.gviweb"(message queue in=w9, error in=w13) -> (dup error in=w80)
    next s1 = w14
    stop if w15
  }
  Register For Events("Stop Event"=w3) -> (event registration refnum out=w81)
  s2 = w81  # shift register
  while {
    event (dynamic events = s2) {
      on dynamic event 0 {
        # The Message Handling Loop processed an "Exit" message, which fired this event to stop the Event Handling Loop.
        w82 = TRUE
        w83 = no error
        w84 = w8
      }
      on "Download" Value changed {
        call "Enqueue Message (Single).gviweb"(message queue in=w8, message="Download Package") -> (message queue out=w84, error out=w83)
        w82 = default
      }
      on "Version" Value changed {
        Event Data() -> ("New Value"=w85)
        Number To Decimal String(number=w85) -> (decimal integer string=w86)
        call "Enqueue Message (Single).gviweb"(message queue in=w8, message="Version changed", message data=w86) -> (message queue out=w84)
        w82 = default
        w83 = default
      }
    }
    call "Error Handler - Event Handling Loop.gviweb"(message queue in=w84, error in=w83) -> (dup error in=w87)
    stop if w82
  }
  Unregister For Events(error in=w87, event registration refnum=s2) -> (error out=w88)
  Merge Errors(w88, w80) -> (error out=w89)
  Destroy User Event(error in=w89, user event=w3)
