vi "Packages.gviweb"   [LabVIEW NXG Preview 4.0.0]
# This template is for the Queued Message Handler design pattern. The Event Handling Loop generates messages based on user interface actions. The Message Handling Loop processes messages generated by the Event Handling Loop, or by other messages. The messages are string values, so new messages can be added easily to the Message Cases case structure in the Message Handling Loop. Each message cluster can also provide an optional value for Message Data,  which is a String that can be swapped to whatever type of data is required.
panel controls:
  "Search": string
  "First": bool
  "Previous": bool
  "Next": bool
  "Last": bool
  "Package Details": bool
  "Repo Type": i32[]
  "Repo Name": i32[]
panel indicators:
  "Tree": T1[]
  "Status string": string
  "URL Image": string
  "PrototypedBy": string
types:
  T1 = cluster{"Element 0": string, "Data": string, "Data_2": string}
  "List Packages Settings--cluster.gtype" = cluster{"PageNumber": i32, "SearchCriteria": string, "Filters": "Package Filters.gtype"}
  "List Details--cluster.gtype" = cluster{"TotalPackages": i32, "TotalPages": i32, "PagesBefore": i32, "PagesAfter": i32, "ItemsPerPage": i32}
  "Package--cluster.gtype" = cluster{"Name": string, "DisplayName": string, "RepoType": string, "RepoName": string, "Versions": "Package Version.gtype"[]}
  T2 = cluster{"BaseURL": string, "Settings": "List Packages Settings--cluster.gtype", "List Details": "List Details--cluster.gtype", "Packages": "Package--cluster.gtype"[], "All Tags": string[], "All Indexes": cluster{"Package": i32, "Version": i32}[]}
uses:
  QMH support::Message Queue::Create All Message Queues.gviweb
  HTTP Client API::Base URL--constant.gvi
  QMH support::Message Queue::Dequeue Message.gviweb
  QMH support::Message Queue::Enqueue Message (Single).gviweb
  BusyStateAPI::BusyStateAPI.jsli::SetBusy
  HTTP Client API::Connection::Open Connection.gvi
  HTTP Client API::Packages::List Packages.gvi
  HTTP Client API::Connection::Close Connection.gvi
  BusyStateAPI::BusyStateAPI.jsli::UnsetBusy
  WebApp::Support::Format Packages for Tree Display.gvi
  HTTP Client API::Packages::Get Package Filters.gvi
  WebApp::Support::Build Status String.gvi
  HTTP Client API::Packages::Set Package.gvi
  RedirectURL::Redirect.jsli::Redirect
  NI::G Core::Error::Read Error Code.gvi
  Error Handling::Error Handler.gvi
  NI::G Core::Error::Build Error Cluster.gvi
  QMH support::Error Handler - Message Handling Loop.gviweb
  QMH support::Error Handler - Event Handling Loop.gviweb
diagram:
  w1 = bool TRUE  # Stop Event
  Create User Event[EventName="Stop Event"](user event data type=w1) -> (error out=w2, user event out=w3)
  call "Create All Message Queues.gviweb"(error in=w2) -> (message queues=w4, error out=w5)
  call "Base URL--constant.gvi"() -> (Base URL=w6)
  w7 = T2 {"Settings"={"PageNumber"=1, "SearchCriteria"="", "Filters"={"RepoTypes"=[], "RepoNames"=[]}}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}
  Property Node(instance in=w7, "BaseURL"=w6) -> (instance out=w8)
  Property Node(instance in=w4) -> ("UI"=w9)
  s1 = w8  # shift register
  while {
    call "Dequeue Message.gviweb"(message queue in=w9, error in=w5) -> (message queue out=w10, message=w11, message data=w12, error out=w13)
    # s1: Data
    # w3: Stop Event
    case (w11) ignore case {  # Message Cases
      frame "Initialize" {
        Property Node(instance in=s1, "Settings:PageNumber"=1) -> (instance out=w15)
        Property Node(instance in=reference to "Tree", "ColumnHeaders"=["Name - Version", "Release Date", "Vendor"])
        call "Enqueue Message (Single).gviweb"(message queue in=w10, message="Get Filters", error in=w13) -> (message queue out=w17, error out=w18)
        call "Enqueue Message (Single).gviweb"(message queue in=w17, message="List Packages", error in=w18) -> (error out=w14)
        w16 = default
      }
      frame "List Packages" {
        Property Node(instance in=s1) -> ("BaseURL"=w19, "Settings"=w20, instance out=w21)
        call "SetBusy"(error in=w13) -> (error out=w22)
        call "Open Connection.gvi"(Root URL=w19, error in=w22) -> (Connection=w23, error out=w24)
        call "List Packages.gvi"(Connection in=w23, List Packages Settings=w20, error in=w24) -> (Connection out=w25, Packages=w26, List Details=w27, error out=w28)
        Property Node(instance in=w21, "Packages"=w26, "List Details"=w27) -> (instance out=w15)
        call "Close Connection.gvi"(Connection in=w25, error in=w28) -> (error out=w29)
        call "UnsetBusy"(error in=w29) -> (error out=w30)
        call "Enqueue Message (Single).gviweb"(message queue in=w10, message="Display Packages List", error in=w30) -> (error out=w14)
        w16 = default
      }
      frame "Display Packages List" {
        Property Node(instance in=s1) -> ("Packages"=w31, instance out=w32)
        call "SetBusy"(error in=w13) -> (error out=w33)
        call "Format Packages for Tree Display.gvi"(Packages=w31, error in=w33) -> (Packages Tree=w34, All Tags=w35, All Indexes=w36, error out=w37)
        $Tree <- w34
        Property Node(instance in=w32, "All Tags"=w35, "All Indexes"=w36) -> (instance out=w15)
        call "UnsetBusy"(error in=w37) -> (error out=w38)
        call "Enqueue Message (Single).gviweb"(message queue in=w10, message="Refresh Controls", error in=w38) -> (error out=w14)
        # Force reset scroll position
        Array Index(array=w35) -> (out0[0]=w39)
        Open Tree Item(reference in=reference to "Tree", location=w39) -> (reference out=w40)
        Close Tree Item(reference in=w40, location=w39)
        w16 = default
      }
      frame "Get Filters" {
        Property Node(instance in=s1) -> ("BaseURL"=w41, instance out=w42)
        call "SetBusy"(error in=w13) -> (error out=w43)
        call "Open Connection.gvi"(Root URL=w41, error in=w43) -> (Connection=w44, error out=w45)
        call "Get Package Filters.gvi"(Connection in=w44, error in=w45) -> (Connection out=w46, Filters=w47, error out=w48)
        Property Node(instance in=w47) -> ("RepoTypes"=w49, "RepoNames"=w50)
        Array Index(array=w49) -> (out0[_]=w51)
        Build Array(w51) -> w52
        Array Index(array=w50) -> (out0[_]=w53)
        Build Array(w53) -> w54
        Property Node(instance in=w42, "Settings:Filters:RepoTypes"=w52, "Settings:Filters:RepoNames"=w54) -> (instance out=w15)
        Property Node(instance in=reference to "Repo Type", "Items"=w49, "Value"=[0])
        Property Node(instance in=reference to "Repo Name", "Items"=w50, "Value"=[0])
        call "Close Connection.gvi"(Connection in=w46, error in=w48) -> (error out=w55)
        call "UnsetBusy"(error in=w55) -> (error out=w14)
        w16 = default
      }
      frame "Search value changed" {
        Property Node(instance in=s1) -> ("Settings"=w56, instance out=w57)
        Property Node(instance in=w56, "SearchCriteria"=w12, "PageNumber"=1) -> (instance out=w58)
        Property Node(instance in=w57, "Settings"=w58) -> (instance out=w15)
        Flatten To JSON(anything=w58) -> (JSON string=w59)
        call "Enqueue Message (Single).gviweb"(message queue in=w10, message="List Packages", message data=w59, error in=w13) -> (error out=w14)
        w16 = default
      }
      frame "Tree Selection Changed" {
        Property Node(instance in=s1) -> ("All Tags"=w60, instance out=w15)
        Match Pattern(regular expression="\\\\", string=w12) -> (offset past match=w61)
        Is Greater Or Equal To 0(x=w61) -> w62
        case (w62) {
          frame False, Default {
            Search 1D Array(1D array=w60, element=w12) -> (index of element=w63)
            Increment(x=w63) -> w64
            Array Index(array=w60) -> (out0[w64]=w65)
            Property Node(instance in=reference to "Tree", "Selection"=w65)
          }
          frame True { }
        }
        call "Enqueue Message (Single).gviweb"(message queue in=w10, message="Refresh Controls", error in=w13) -> (error out=w14)
        w16 = default
      }
      frame "Refresh Controls" {
        Build Array(reference to "First", reference to "Previous", reference to "Next", reference to "Last") -> w66
        Property Node(instance in=s1) -> ("List Details:PagesBefore"=w67, "List Details:PagesAfter"=w68, "Settings"=w69, "List Details"=w70, instance out=w15)
        Is Equal To 0(x=w67) -> w71
        case (w71) {
          frame False, Default {
            w72 = FALSE
            w73 = FALSE
          }
          frame True {
            w72 = TRUE
            w73 = TRUE
          }
        }
        Is Equal To 0(x=w68) -> w74
        case (w74) {
          frame False, Default {
            w75 = FALSE
            w76 = FALSE
          }
          frame True {
            w75 = TRUE
            w76 = TRUE
          }
        }
        Build Array(w72, w73, w75, w76) -> w77
        for {
          w78 = each element of w77
          w79 = each element of w66
          Property Node(instance in=w79, "Disabled"=w78)
        }
        call "Build Status String.gvi"(List Package settings=w69, List Details=w70) -> (Status String=w80)
        $"Status string" <- w80
        Property Node(instance in=reference to "Tree") -> ("SelectedData"=w81)
        Property Node(instance in=w81) -> ("Element 0"=w82)
        Match Pattern(regular expression="\\\\", string=w82) -> (offset past match=w83)
        Is Greater Or Equal To 0(x=w83) -> w84
        Not(x=w84) -> w85
        Property Node(instance in=reference to "Package Details", "Disabled"=w85)
        w14 = w13
        w16 = default
      }
      frame "Show Package Details" {
        call "SetBusy"(error in=w13) -> (error out=w86)
        Property Node(instance in=s1) -> ("BaseURL"=w87, "Packages"=w88, "All Indexes"=w89, "All Tags"=w90, instance out=w15)
        call "Open Connection.gvi"(Root URL=w87, error in=w86) -> (Connection=w91, error out=w92)
        Property Node(instance in=reference to "Tree") -> ("SelectedData"=w93)
        Property Node(instance in=w93) -> ("Element 0"=w94)
        Search 1D Array(1D array=w90, element=w94) -> (index of element=w95)
        Array Index(array=w89) -> (out0[w95]=w96)
        Property Node(instance in=w96) -> ("Package"=w97, "Version"=w98)
        Array Index(array=w88) -> (out0[w97]=w99)
        Property Node(instance in=w99) -> ("Name"=w100, "Versions"=w101)
        Array Index(array=w101) -> (out0[w98]=w102)
        Property Node(instance in=w102) -> ("Version"=w103)
        call "Set Package.gvi"(Connection in=w91, Name=w100, Version=w103, error in=w92) -> (Connection out=w104, error out=w105)
        call "Close Connection.gvi"(Connection in=w104, error in=w105) -> (error out=w106)
        call "Redirect"(URL="PackageDetails.html", target="_blank", error in=w106) -> (error out=w107)
        call "UnsetBusy"(error in=w107) -> (error out=w14)
        w16 = default
      }
      frame "Repo Type changed" {
        Unflatten From JSON(JSON string=w12, type and defaults=i32[] []) -> (value=w108)
        Is Empty Array(array=w108) -> w109
        case (w109) {
          frame False, Default {
            w110 = w108
          }
          frame True {
            w110 = [0]
          }
        }
        Property Node(instance in=reference to "Repo Type", "Value"=w110) -> ("Items"=w111)
        for {
          w112 = each element of w110
          Array Index(array=w111) -> (out0[w112]=w114)
          append w114 to w113
        }
        Property Node(instance in=s1, "Settings:Filters:RepoTypes"=w113) -> (instance out=w15)
        call "Enqueue Message (Single).gviweb"(message queue in=w10, message="List Packages", error in=w13) -> (error out=w14)
        w16 = default
      }
      frame "Repo Name changed" {
        Unflatten From JSON(JSON string=w12, type and defaults=i32[] []) -> (value=w115)
        Is Empty Array(array=w115) -> w116
        case (w116) {
          frame False, Default {
            w117 = w115
          }
          frame True {
            w117 = [0]
          }
        }
        Property Node(instance in=reference to "Repo Name", "Value"=w117) -> ("Items"=w118)
        for {
          w119 = each element of w117
          Array Index(array=w118) -> (out0[w119]=w121)
          append w121 to w120
        }
        Property Node(instance in=s1, "Settings:Filters:RepoNames"=w120) -> (instance out=w15)
        call "Enqueue Message (Single).gviweb"(message queue in=w10, message="List Packages", error in=w13) -> (error out=w14)
        w16 = default
      }
      frame "First" {
        Property Node(instance in=s1) -> ("Settings"=w122, instance out=w123)
        Property Node(instance in=w122, "PageNumber"=1) -> (instance out=w124)
        Property Node(instance in=w123, "Settings"=w124) -> (instance out=w15)
        Flatten To JSON(anything=w124) -> (JSON string=w125)
        call "Enqueue Message (Single).gviweb"(message queue in=w10, message="List Packages", message data=w125, error in=w13) -> (error out=w14)
        w16 = default
      }
      frame "Last" {
        Property Node(instance in=s1) -> ("Settings"=w126, "List Details:TotalPages"=w127, instance out=w128)
        Property Node(instance in=w126, "PageNumber"=w127) -> (instance out=w129)
        Property Node(instance in=w128, "Settings"=w129) -> (instance out=w15)
        Flatten To JSON(anything=w129) -> (JSON string=w130)
        call "Enqueue Message (Single).gviweb"(message queue in=w10, message="List Packages", message data=w130, error in=w13) -> (error out=w14)
        w16 = default
      }
      frame "Previous" {
        Property Node(instance in=s1) -> ("Settings"=w131, "Settings:PageNumber"=w132, instance out=w133)
        Decrement(x=w132) -> w134
        Property Node(instance in=w131, "PageNumber"=w134) -> (instance out=w135)
        Property Node(instance in=w133, "Settings"=w135) -> (instance out=w15)
        Flatten To JSON(anything=w135) -> (JSON string=w136)
        call "Enqueue Message (Single).gviweb"(message queue in=w10, message="List Packages", message data=w136, error in=w13) -> (error out=w14)
        w16 = default
      }
      frame "Next" {
        Property Node(instance in=s1) -> ("Settings"=w137, "Settings:PageNumber"=w138, instance out=w139)
        Increment(x=w138) -> w140
        Property Node(instance in=w137, "PageNumber"=w140) -> (instance out=w141)
        Property Node(instance in=w139, "Settings"=w141) -> (instance out=w15)
        Flatten To JSON(anything=w141) -> (JSON string=w142)
        call "Enqueue Message (Single).gviweb"(message queue in=w10, message="List Packages", message data=w142, error in=w13) -> (error out=w14)
        w16 = default
      }
      frame "Error" {
        # Process Error
        w143 = no error  # Error
        Unflatten From JSON(JSON string=w12, error in (no error)=w13, type and defaults=w143) -> (error out=w14, value=w144)
        call "Read Error Code.gvi"(error in=w144) -> (code=w145)
        case (w145) {
          frame 501401 {
            # Redirect to Login page
            call "Redirect"(URL="Login.html")
          }
          frame 0, Default {
            # Display Error
            call "Error Handler.gvi"(error in=w144)
          }
        }
        w15 = s1
        w16 = default
      }
      frame "---Copy This Frame---" {
        Merge Errors(w13) -> (error out=w14)
        w15 = s1
        w16 = default
      }
      frame "Exit" {
        # Release the message queue reference
        Release Queue(error in=w13, queue=w10) -> (error out=w146)
        Generate User Event(event data=TRUE, user event=w3) -> (error out=w147)
        Merge Errors(w147, w146) -> (error out=w14)
        # Stop the VI
        w15 = s1
        w16 = TRUE
      }
      frame Default {
        w148 = "The invalid message string \"%s\" was received in the Message Handling Loop."
        Format Into String(formatString=w148, w11) -> w149
        call "Build Error Cluster.gvi"(code=1, description=w149) -> (error out=w14)
        w15 = s1
        w16 = default
      }
    }
    call "Error Handler - Message Handling Loop.gviweb"(message queue in=w10, error in=w14) -> (dup error in=w150)
    next s1 = w15
    stop if w16
  }
  Register For Events("Stop Event"=w3) -> (event registration refnum out=w151)
  s2 = w151  # shift register
  while {
    event (dynamic events = s2) {
      on "Dynamic" Stop Event {
        # The Message Handling Loop processed an "Exit" message, which fired this event to stop the Event Handling Loop.
        w152 = TRUE
        w153 = no error
        w154 = w9
      }
      on "Tree" Selection changed {
        Event Data() -> ("NewSelection"=w155)
        call "Enqueue Message (Single).gviweb"(message queue in=w9, message="Tree Selection Changed", message data=w155) -> (message queue out=w154, error out=w153)
        w152 = default
      }
      on "Search" Value changed {
        Event Data() -> ("New Value"=w156)
        call "Enqueue Message (Single).gviweb"(message queue in=w9, message="Search value changed", message data=w156) -> (message queue out=w154, error out=w153)
        w152 = default
      }
      on "First" Value changed {
        call "Enqueue Message (Single).gviweb"(message queue in=w9, message="First") -> (message queue out=w154, error out=w153)
        w152 = default
      }
      on "Last" Value changed {
        call "Enqueue Message (Single).gviweb"(message queue in=w9, message="Last") -> (message queue out=w154, error out=w153)
        w152 = default
      }
      on "Next" Value changed {
        call "Enqueue Message (Single).gviweb"(message queue in=w9, message="Next") -> (message queue out=w154, error out=w153)
        w152 = default
      }
      on "Previous" Value changed {
        call "Enqueue Message (Single).gviweb"(message queue in=w9, message="Previous") -> (message queue out=w154, error out=w153)
        w152 = default
      }
      on "Package Details" Value changed {
        call "Enqueue Message (Single).gviweb"(message queue in=w9, message="Show Package Details") -> (message queue out=w154, error out=w153)
        w152 = default
      }
      on "Repo Type" Value changed {
        Event Data() -> ("Old Value"=w157, "New Value"=w158)
        Is Equal[ComparisonMode=CompareAggregates](x=w157, y=[0]) -> w159
        case (w159) {
          frame False, Default {
            Search 1D Array(1D array=w157, element=0) -> (index of element=w161)
            case (w161) {
              frame -1 {
                Search 1D Array(1D array=w158, element=0) -> (index of element=w162)
                Is Greater Or Equal To 0(x=w162) -> w163
                Select(s=w163, t=[0], f=w158) -> w160
              }
              frame Default {
                Delete From Array(inArray=w158, index0=w161) -> w160
              }
            }
          }
          frame True {
            Search 1D Array(1D array=w158, element=0) -> (index of element=w164)
            Delete From Array(inArray=w158, index0=w164) -> w160
          }
        }
        Flatten To JSON(anything=w160) -> (JSON string=w165)
        call "Enqueue Message (Single).gviweb"(message queue in=w9, message="Repo Type changed", message data=w165) -> (message queue out=w154)
        w152 = default
        w153 = default
      }
      on "Repo Name" Value changed {
        Event Data() -> ("Old Value"=w166, "New Value"=w167)
        Is Equal[ComparisonMode=CompareAggregates](x=w166, y=[0]) -> w168
        case (w168) {
          frame False, Default {
            Search 1D Array(1D array=w166, element=0) -> (index of element=w170)
            case (w170) {
              frame -1 {
                Search 1D Array(1D array=w167, element=0) -> (index of element=w171)
                Is Greater Or Equal To 0(x=w171) -> w172
                Select(s=w172, t=[0], f=w167) -> w169
              }
              frame Default {
                Delete From Array(inArray=w167, index0=w170) -> w169
              }
            }
          }
          frame True {
            Search 1D Array(1D array=w167, element=0) -> (index of element=w173)
            Delete From Array(inArray=w167, index0=w173) -> w169
          }
        }
        Flatten To JSON(anything=w169) -> (JSON string=w174)
        call "Enqueue Message (Single).gviweb"(message queue in=w9, message="Repo Name changed", message data=w174) -> (message queue out=w154)
        w152 = default
        w153 = default
      }
    }
    call "Error Handler - Event Handling Loop.gviweb"(message queue in=w154, error in=w153) -> (dup error in=w175)
    stop if w152
  }
  Unregister For Events(error in=w175, event registration refnum=s2) -> (error out=w176)
  Merge Errors(w176, w150) -> (error out=w177)
  Destroy User Event(error in=w177, user event=w3)
