vi "QMH Template.gviweb"   [LabVIEW NXG 3.1.0]
# This template is for the Queued Message Handler design pattern. The Event Handling Loop generates messages based on user interface actions. The Message Handling Loop processes messages generated by the Event Handling Loop, or by other messages. The messages are string values, so new messages can be added easily to the Message Cases case structure in the Message Handling Loop. Each message cluster can also provide an optional value for Message Data,  which is a String that can be swapped to whatever type of data is required.
uses:
  QMH support::Message Queue::Create All Message Queues.gviweb
  HTTP Client API::Base URL--constant.gvi
  QMH support::Message Queue::Dequeue Message.gviweb
  QMH support::Message Queue::Enqueue Message (Single).gviweb
  NI::G Core::Error::Read Error Code.gvi
  RedirectURL::Redirect.jsli::Redirect
  Error Handling::Error Handler.gvi
  NI::G Core::Error::Build Error Cluster.gvi
  QMH support::Error Handler - Message Handling Loop.gviweb
  QMH support::Error Handler - Event Handling Loop.gviweb
diagram:
  w1 = bool TRUE  # Stop Event
  Create User Event[EventName="Stop Event"](user event data type=w1) -> (error out=w2, user event out=w3)
  call "Create All Message Queues.gviweb"(error in=w2) -> (message queues=w4, error out=w5)
  call "Base URL--constant.gvi"() -> (Base URL=w6)
  Property Node(instance in=cluster{"BaseURL": string} {all zero or empty}, "BaseURL"=w6) -> (instance out=w7)
  Property Node(instance in=w4) -> ("UI"=w8)
  s1 = w7  # shift register
  while {
    call "Dequeue Message.gviweb"(message queue in=w8, error in=w5) -> (message queue out=w9, message=w10, message data=w11, error out=w12)
    # s1: Data
    # w3: Stop Event
    case (w10) ignore case {  # Message Cases
      frame "Initialize" {
        # Check authentication on Web Services.
        # An Error 501401 will be returned if not authenticated
        call "Enqueue Message (Single).gviweb"(message queue in=w9, message="List Packages", error in=w12) -> (error out=w13)
        w14 = s1
        w15 = default
      }
      frame "Error" {
        # Process Error
        w16 = no error  # Error
        Unflatten From JSON(JSON string=w11, error in (no error)=w12, type and defaults=w16) -> (error out=w13, value=w17)
        call "Read Error Code.gvi"(error in=w17) -> (code=w18)
        case (w18) {
          frame 501401 {
            # Redirect to Login page
            call "Redirect"(URL="Login.html")
          }
          frame 0, Default {
            # Display Error
            call "Error Handler.gvi"(error in=w17)
          }
        }
        w14 = s1
        w15 = default
      }
      frame "---Copy This Frame---" {
        Merge Errors(w12) -> (error out=w13)
        w14 = s1
        w15 = default
      }
      frame "Exit" {
        # Release the message queue reference
        Release Queue(error in=w12, queue=w9) -> (error out=w19)
        Generate User Event(event data=TRUE, user event=w3) -> (error out=w20)
        Merge Errors(w20, w19) -> (error out=w13)
        # Stop the VI
        w14 = s1
        w15 = TRUE
      }
      frame Default {
        w21 = "The invalid message string \"%s\" was received in the Message Handling Loop."
        Format Into String(formatString=w21, w10) -> w22
        call "Build Error Cluster.gvi"(code=1, description=w22) -> (error out=w13)
        w14 = s1
        w15 = default
      }
    }
    call "Error Handler - Message Handling Loop.gviweb"(message queue in=w9, error in=w13) -> (dup error in=w23)
    next s1 = w14
    stop if w15
  }
  Register For Events("Stop Event"=w3) -> (event registration refnum out=w24)
  s2 = w24  # shift register
  while {
    event (dynamic events = s2) {
      on "Dynamic" Stop Event {
        # The Message Handling Loop processed an "Exit" message, which fired this event to stop the Event Handling Loop.
        w25 = TRUE
        w26 = no error
        w27 = w8
      }
    }
    call "Error Handler - Event Handling Loop.gviweb"(message queue in=w27, error in=w26) -> (dup error in=w28)
    stop if w25
  }
  Unregister For Events(error in=w28, event registration refnum=s2) -> (error out=w29)
  Merge Errors(w29, w23) -> (error out=w30)
  Destroy User Event(error in=w30, user event=w3)
