vi "Deserialize JSON Timestamp.gvi"   [LabVIEW NXG 3.1.0]
inputs:
  "Timestamp String": string
  "Error in": error
outputs:
  "Timestamp": timestamp
  "Error out": error
diagram:
  w1 = ["%^<%Y-%m-%dT%H:%M:%S%99uZ>T", "%^<%Y-%m-%dT%H:%M:%S%99u>T", "%^<%Y-%m-%dT%H:%M:%S>T", "%^<%Y%m%dT%H:%M:%S>T", "%^<%H:%M:%S %d-%m-%Y >T", "%^<%H:%M:%S %d.%m.%Y >T", "%^<%m/%d/%Y %I:%M:%S %p>T", "%^<%Y%m%d_%Hh%Mm%S>T", "%^<%j/%H:%M:%S>T", "%^<%j:%H:%M:%S>T", "%^<%c>T"]
  case ($"Timestamp String") {
    frame Default {
      while {
        w4 = each element of w1
        case (w4) {
          frame "" {
            w5 = FALSE
            w2 = 1904-01-01T00:00:00Z
            w3 = $"Error in"
          }
          frame "xxx", Default {
            Scan From String(formatString=w4, inputString=$"Timestamp String", errIn=$"Error in", default=1904-01-01T00:00:00Z) -> (offsetPastScan=w6, errOut=w3, out0=w2)
            Is Less Or Equal To 0(x=w6) -> w7
            Logical Or(w3, w7) -> w5
          }
        }
        continue if w5
      }
    }
    frame "null" {
      w2 = 1904-01-01T00:00:00Z
      w3 = $"Error in"
    }
  }
  $Timestamp <- w2
  $"Error out" <- w3
