vi "Format Packages for Tree Display.gvi"   [LabVIEW NXG Preview 4.0.0]
inputs:
  "Packages": "Package--cluster.gtype"[], required
  "error in": error
outputs:
  "Packages Tree": T1[]
  "error out": error
  "All Tags": string[]
  "All Indexes": cluster{"Element 1": i32, "Element 2": i32}[]
types:
  "Package Version.gtype" = cluster{"ReleaseDate": string, "Version": string, "DisplayName": string, "Description": string, "Vendor": string, "Author": string, "Release Notes": string, "Dependencies": string[], "IconURL": string, "PackageURL": string}
  "Package--cluster.gtype" = cluster{"Name": string, "DisplayName": string, "RepoType": string, "RepoName": string, "Versions": "Package Version.gtype"[]}
  T1 = cluster{"Element 0": string, "Element 1": string, "Element 2": string}
uses:
  WebApp::Support::JSON Timestamp to Display.gvi
diagram:
  for (iteration -> i1) {
    w1 = each element of $Packages
    Property Node(instance in=w1) -> ("DisplayName"=w5, "Versions"=w6, "RepoName"=w7, "RepoType"=w8)
    Format Into String(formatString="%s (%s)", w7, w8) -> w9
    for (iteration -> i2) {
      w10 = each element of w6
      Property Node(instance in=w10) -> ("Version"=w16, "ReleaseDate"=w17, "Vendor"=w18)
      Concatenate Strings(w5, "\\", w16) -> w19
      call "JSON Timestamp to Display.gvi"(JSON Timestamp=w17) -> (Display Timestamp=w20)
      Build Array(w19, w20, "") -> w21
      Array To Cluster[NumberOfClusterElements=3](array=w21) -> (cluster=w22)
      Build Cluster(i1, i2) -> w23
      append w22 to w11
      append w18 to w12
      append w19 to w13
      append w23 to w14
      append w9 to w15
    }
    Array Index(array=w12) -> (out0[_]=w24)
    Array Index(array=w15) -> (out0[_]=w25)
    Build Array(w5, w24, w25) -> w26
    Array To Cluster[NumberOfClusterElements=3](array=w26) -> (cluster=w27)
    Build Array(w27, w11) -> w28
    Build Array(w5, w13) -> w29
    Build Cluster(i1, -1) -> w30
    Build Array(w30, w14) -> w31
    concatenate w28 onto w2
    concatenate w29 onto w3
    concatenate w31 onto w4
  }
  $"Packages Tree" <- w2
  $"All Tags" <- w3
  $"All Indexes" <- w4
  $"error out" <- $"error in"
