vi "Generate GPM Install Command.gvi"   [LabVIEW NXG 4.0.0]
inputs:
  "Package Version": "Package Version--cluster.gtype", required
outputs:
  "GPM Install Command": string
types:
  "Package Version--cluster.gtype" = cluster{"ReleaseDate": string, "Version": string, "Name": string, "DisplayName": string, "Description": string, "Vendor": string, "Author": string, "Release Notes": string, "Dependencies": string[], "IconURL": string, "PackageURL": string, "RepoType": string, "RepoName": string}
uses:
  WebApp::Support::RepoType string to enum.gvi
diagram:
  Property Node(instance in=$"Package Version") -> ("RepoType"=w1, "Name"=w2, "Version"=w3)
  call "RepoType string to enum.gvi"(RepoType string=w1) -> (RepoType=w4)
  case (w4) {
    frame "VIPM", Default {
      w5 = default
    }
    frame "GPM" {
      Format Into String(formatString="gpm install %s@^%s", w2, w3) -> w5
    }
  }
  $"GPM Install Command" <- w5
