vi "Get Package Name and Version from URL.gvi"   [LabVIEW NXG 4.0.0]
inputs:
  "error in": error
outputs:
  "error out": error
  "Package Name": string
  "Package Version": string
uses:
  URL::Get Window Location.gvi
  URL::Parse URL.gvi
  URL::Parse URL Search Params.gvi
diagram:
  call "Get Window Location.gvi"(error in=$"error in") -> (url=w1, error out=w2)
  call "Parse URL.gvi"(url=w1, error in=w2) -> (url parts=w3, error out=w4)
  Property Node(instance in=w3) -> ("search"=w5)
  call "Parse URL Search Params.gvi"(search=w5, error in=w4) -> (search params=w6, error out=w7)
  for {
    w8 = each element of w6
    Property Node(instance in=w8) -> ("value"=w11, "key"=w12)
    To Lower Case(string=w12) -> w13
    append w13 to w9
    append w11 to w10
  }
  Search 1D Array(1D array=w9, element="name") -> (index of element=w14)
  Array Index(array=w10) -> (out0[w14]=w15)
  $"Package Name" <- w15
  Search 1D Array(1D array=w9, element="version") -> (index of element=w16)
  Array Index(array=w10) -> (out0[w16]=w17)
  $"Package Version" <- w17
  $"error out" <- w7
