vi "JSON Timestamp to Display.gvi"   [LabVIEW NXG 3.1.0]
inputs:
  "JSON Timestamp": string, required
  "Error in": error
outputs:
  "Display Timestamp": string
  "error out": error
uses:
  WebApp::Support::Deserialize JSON Timestamp.gvi
diagram:
  call "Deserialize JSON Timestamp.gvi"(Timestamp String=$"JSON Timestamp", Error in=$"Error in") -> (Timestamp=w1, Error out=w2)
  Format Into String(formatString="%<%Y/%m/%d %H:%M>T", errIn=w2, w1) -> (outString=w3, errOut=w4)
  $"Display Timestamp" <- w3
  $"error out" <- w4
