vi "Join Strings.gvi"   [LabVIEW NXG Preview 4.0.0]
inputs:
  "String Array Input": string[], required
  "Separator": string, required
outputs:
  "String output": string
diagram:
  Array Size(array=$"String Array Input") -> (size(s)=w1)
  Decrement(x=w1) -> w2
  s1 = ""  # shift register
  for (iteration -> i1) {
    w3 = each element of $"String Array Input"
    Is Equal(x=w2, y=i1) -> w4
    Select(s=w4, t="", f=$Separator) -> w5
    Concatenate Strings(s1, w3, w5) -> w6
    next s1 = w6
  }
  $"String output" <- s1
