vi "Remove Duplicates from Array of strings.gvi"   [LabVIEW NXG Preview 4.0.0]
inputs:
  "Input Array": string[]
outputs:
  "Output Array": string[]
  "indices of removed elements": i32[]
diagram:
  s1 = i32[] []  # shift register
  s2 = string[] []  # shift register
  for (iteration -> i1) {
    w1 = each element of $"Input Array"
    Search 1D Array(1D array=s2, element=w1) -> (index of element=w2)
    case (w2) {
      frame -1 {
        Build Array(s2, w1) -> w4
        w3 = s1
      }
      frame Default {
        Build Array(s1, i1) -> w3
        w4 = s2
      }
    }
    next s1 = w3
    next s2 = w4
  }
  $"Output Array" <- s2
  $"indices of removed elements" <- s1
