vi "index.gviweb"   [LabVIEW NXG Preview 4.0.0]
panel controls:
  "Packages": bool
panel indicators:
  "URL Image": string
  "PrototypedBy": string
uses:
  QMH support::Message Queue::Create All Message Queues.gviweb
  HTTP Client API::Base URL--constant.gvi
  QMH support::Message Queue::Dequeue Message.gviweb
  BusyStateAPI::BusyStateAPI.jsli::SetBusy
  HTTP Client API::Website Version.gvi
  HTTP Client API::Connection::Open Connection.gvi
  HTTP Client API::WebServices Version.gvi
  HTTP Client API::Connection::Close Connection.gvi
  BusyStateAPI::BusyStateAPI.jsli::UnsetBusy
  RedirectURL::Redirect.jsli::Redirect
  NI::G Core::Error::Read Error Code.gvi
  Error Handling::Error Handler.gvi
  NI::G Core::Error::Build Error Cluster.gvi
  QMH support::Error Handler - Message Handling Loop.gviweb
  QMH support::Message Queue::Enqueue Message (Single).gviweb
  QMH support::Error Handler - Event Handling Loop.gviweb
diagram:
  w1 = bool TRUE  # Stop Event
  Create User Event[EventName="Stop Event"](user event data type=w1) -> (error out=w2, user event out=w3)
  call "Create All Message Queues.gviweb"(error in=w2) -> (message queues=w4, error out=w5)
  call "Base URL--constant.gvi"() -> (Base URL=w6)
  Property Node(instance in=cluster{"BaseURL": string} {all zero or empty}, "BaseURL"=w6) -> (instance out=w7)
  Property Node(instance in=w4) -> ("UI"=w8)
  s1 = w7  # shift register
  while {
    call "Dequeue Message.gviweb"(message queue in=w8, error in=w5) -> (message queue out=w9, message=w10, message data=w11, error out=w12)
    # s1: Data
    # w3: Stop Event
    case (w10) ignore case {  # Message Cases
      frame "Initialize" {
        call "SetBusy"(error in=w12) -> (error out=w16)
        call "Website Version.gvi"(error in=w16) -> (Version=w17, error out=w18)
        Property Node(instance in=s1) -> ("BaseURL"=w19, instance out=w14)
        call "Open Connection.gvi"(Root URL=w19, error in=w18) -> (Connection=w20, error out=w21)
        call "WebServices Version.gvi"(Connection in=w20, error in=w21) -> (Connection out=w22, version=w23, error out=w24)
        Format Into String(formatString="Website version: %s\nWebServices version: %s", w17, w23) -> w25
        Property Node(instance in=reference to unnamed text, "Text"=w25)
        call "Close Connection.gvi"(Connection in=w22, error in=w24) -> (error out=w26)
        call "UnsetBusy"(error in=w26) -> (error out=w13)
        w15 = default
      }
      frame "Packages" {
        call "Redirect"(URL="Packages.html", target="_self", error in=w12) -> (error out=w13)
        w14 = s1
        w15 = default
      }
      frame "Error" {
        # Process Error
        w27 = no error  # Error
        Unflatten From JSON(JSON string=w11, error in (no error)=w12, type and defaults=w27) -> (error out=w13, value=w28)
        call "Read Error Code.gvi"(error in=w28) -> (code=w29)
        case (w29) {
          frame 501401 {
            # Redirect to Login page
            call "Redirect"(URL="Login.html")
          }
          frame 0, Default {
            # Display Error
            call "Error Handler.gvi"(error in=w28)
          }
        }
        w14 = s1
        w15 = default
      }
      frame "---Copy This Frame---" {
        Merge Errors(w12) -> (error out=w13)
        w14 = s1
        w15 = default
      }
      frame "Exit" {
        # Release the message queue reference
        Release Queue(error in=w12, queue=w9) -> (error out=w30)
        Generate User Event(event data=TRUE, user event=w3) -> (error out=w31)
        Merge Errors(w31, w30) -> (error out=w13)
        # Stop the VI
        w14 = s1
        w15 = TRUE
      }
      frame Default {
        w32 = "The invalid message string \"%s\" was received in the Message Handling Loop."
        Format Into String(formatString=w32, w10) -> w33
        call "Build Error Cluster.gvi"(code=1, description=w33) -> (error out=w13)
        w14 = s1
        w15 = default
      }
    }
    call "Error Handler - Message Handling Loop.gviweb"(message queue in=w9, error in=w13) -> (dup error in=w34)
    next s1 = w14
    stop if w15
  }
  Register For Events("Stop Event"=w3) -> (event registration refnum out=w35)
  s2 = w35  # shift register
  while {
    event (dynamic events = s2) {
      on "Dynamic" Stop Event {
        # The Message Handling Loop processed an "Exit" message, which fired this event to stop the Event Handling Loop.
        w36 = TRUE
        w37 = no error
        w38 = w8
      }
      on "Packages" Value changed {
        call "Enqueue Message (Single).gviweb"(message queue in=w8, message="Packages") -> (message queue out=w38, error out=w37)
        w36 = default
      }
    }
    call "Error Handler - Event Handling Loop.gviweb"(message queue in=w38, error in=w37) -> (dup error in=w39)
    stop if w36
  }
  Unregister For Events(error in=w39, event registration refnum=s2) -> (error out=w40)
  Merge Errors(w40, w34) -> (error out=w41)
  Destroy User Event(error in=w41, user event=w3)
